# Grasshopper definition 04_motion_program.ghx (Grasshopper 1.0.8)
# plug-ins: Motus
# Motion program: PTP + LIN + CIRC + SET gripper (via Merge) -> Motus Program -> Preview / Export. Auto Plan on; drag Motus Scrub or Play.

# ---- group: Robot + start
# 04  Motion program
ur10e = MotusUR10eRobotiq()
joints = MotusJointState(Joints=[0, -0.5, 1, -1, 0, 0])
joints_2 = MotusJointState(Joints=[1.2, -1, 1.2, -1.6, -1.5708, 0])

# ---- group: Moves (merge → Program)
Z = UnitZ()
goalpt = ConstructPoint(X=0.45, Y=0.15, Z=0.45)
goalpt_2 = ConstructPoint(X=0.453, Y=0.152, Z=0.45)
goalpt_3 = ConstructPoint(X=0.45, Y=0.154, Z=0.45)
toolstate = MotusToolState(Tool=ur10e, Preset="Open", Width=0.085, Speed=0.5, Force=0.5)
pl = PlaneNormal(Origin=goalpt, ZAxis=Z)
pl_2 = PlaneNormal(Origin=goalpt_2, ZAxis=Z)
pl_3 = PlaneNormal(Origin=goalpt_3, ZAxis=Z)
toolstate_2 = MotusToolState(Tool=ur10e, Preset="Closed", Width=0.085, Speed=0.5, Force=0.5)
# Note: PTP → LIN → CIRC → SET. Scrub after Program Status OK.
move = MotusMove(Type="PTP", Goal=joints_2, Blend=0, ToolState=toolstate, MotionType="PTP", ToolMode="Hold")
move_2 = MotusMove(Type="LIN", Goal=pl, Blend=0, Step=0.005, MotionType="LIN", ToolMode="Hold")
move_3 = MotusMove(Type="CIRC", Goal=pl_3, Blend=0, Via=pl_2, Samples=16, MotionType="CIRC", ToolMode="Hold")
move_4 = MotusMove(Type="SET", ToolState=toolstate_2, Duration=0.2, MotionType="SET", ToolMode="Hold")
merge = Merge(Data1=move, Data2=move_2, Data3=move_3, Data4=move_4)

# ---- group: Program + preview
program = MotusProgram(Robot=ur10e, Segments=merge, Start=joints, AutoPlan=True)  # -> Trajectory, Status, Warnings
scrub = Slider(0, range=0..1)
preview = MotusPreview(
    Trajectory=program.Trajectory,
    ShowStart=False,
    Position=scrub,
    ColorMode=0,
    ShowCustomColors=False,
    ShowDebugOutputs=False)  # -> Meshes, Links, TCPPath, State, Time
export = MotusExport(Trajectory=program.Trajectory, Retime=True, Validate=False)  # -> Json, Csv, Validation
