# Grasshopper definition 09_walking_hexapod.ghx (Grasshopper 1.0.8)
# plug-ins: Motus
# Walking hexapod (NOT Stewart): WalkHex → joint-space Plan on right-middle leg → Motus Preview + Scrub. Full 18-DOF stance on Tree; tip-path trajectory moves one leg only.

# ---- group: Walking Hex
# 09 · Walking hexapod
# Note: WalkHex → Plan tip leg (right-middle 3-DOF) → Preview scrub. Tip-path = one leg; other legs stay at stance.
walkhex = MotusWalkingHex(BodyR=0.12, Coxa=0.06, Femur=0.17, Tibia=0.19, HipStance=0.1309, FemurStance=0.5236, TibiaStance=-0.5236, BodyZ=0.12)  # -> Robot, State, Meshes, Support

# ---- group: Plan tip leg
joints = MotusJointState(Joints=[-0.1309, 0.5236, -0.5236])
joints_2 = MotusJointState(Joints=[-0.1309, 0.6109, -0.5236])
quick = MotusPlan(
    Robot=walkhex.Robot,
    Goal=joints_2,
    Start=joints,
    Step=0.005,
    AutoPlan=True,
    ShowCollision=False,
    ShowGroup=False,
    ShowAttach=False,
    ShowRrtSettings=False)  # -> Trajectory, Status, Warnings
scrub = Slider(0, range=0..1)
preview = MotusPreview(Trajectory=quick.Trajectory, ShowStart=True, Position=scrub, ColorMode=0, ShowCustomColors=False, ShowDebugOutputs=False)  # -> Meshes, Links, TCPPath, State, Time
